vi "index.gviweb"   [G Web Development Software 22.0.0]
panel controls:
  "Tk,ut (C)": f64
  "Tv,inn (C)": f64 = 90
  "Velg hvilken temperatur som skal beregnes:": string = "0"
  "Tk,inn (C)": f64 = 10
  "Tv,ut (C)": f64 = 60
  "Cp,v (kJ/kgC)": f64 = 4.2
  "Fv (kg/s)": f64 = 20
  "Cp,k (kJ/kgC)": f64 = 4.2
  "Fk (kg/s)": f64 = 20
panel indicators:
  "Q (energi overført, kW)": f64
  "URL Image": string
diagram:
  while {
    case ($"Velg hvilken temperatur som skal beregnes:") {
      frame "2" {
        Subtract(x=$"Tk,ut (C)", y=$"Tk,inn (C)") -> w5
        Multiply(w5, $"Fk (kg/s)") -> w6
        Multiply(w6, $"Cp,k (kJ/kgC)") -> w7
        $"Q (energi overført, kW)" <- w7
        Multiply($"Fv (kg/s)", $"Cp,v (kJ/kgC)") -> w8
        Divide(x=w7, y=w8) -> w9
        Add(w9, $"Tv,ut (C)") -> w10
        $"Tv,inn (C)" <- w10
        w1 = FALSE
        w2 = FALSE
        w3 = TRUE
        w4 = FALSE
      }
      frame "3" {
        Subtract(x=$"Tk,ut (C)", y=$"Tk,inn (C)") -> w11
        Multiply(w11, $"Cp,k (kJ/kgC)") -> w12
        Multiply(w12, $"Fk (kg/s)") -> w13
        $"Q (energi overført, kW)" <- w13
        Multiply($"Fv (kg/s)", $"Cp,v (kJ/kgC)") -> w14
        Divide(x=w13, y=w14) -> w15
        Subtract(x=$"Tv,inn (C)", y=w15) -> w16
        $"Tv,ut (C)" <- w16
        w1 = FALSE
        w2 = FALSE
        w3 = FALSE
        w4 = TRUE
      }
      frame "1" {
        Subtract(x=$"Tv,inn (C)", y=$"Tv,ut (C)") -> w17
        Multiply(w17, $"Cp,v (kJ/kgC)") -> w18
        Multiply(w18, $"Fv (kg/s)") -> w19
        $"Q (energi overført, kW)" <- w19
        Multiply($"Fk (kg/s)", $"Cp,k (kJ/kgC)") -> w20
        Divide(x=w19, y=w20) -> w21
        Subtract(x=$"Tk,ut (C)", y=w21) -> w22
        $"Tk,inn (C)" <- w22
        w1 = FALSE
        w2 = TRUE
        w3 = FALSE
        w4 = FALSE
      }
      frame "0", Default {
        Subtract(x=$"Tv,inn (C)", y=$"Tv,ut (C)") -> w23
        Multiply(w23, $"Cp,v (kJ/kgC)") -> w24
        Multiply(w24, $"Fv (kg/s)") -> w25
        $"Q (energi overført, kW)" <- w25
        Multiply($"Fk (kg/s)", $"Cp,k (kJ/kgC)") -> w26
        Divide(x=w25, y=w26) -> w27
        Add(w27, $"Tk,inn (C)") -> w28
        $"Tk,ut (C)" <- w28
        w1 = TRUE
        w2 = FALSE
        w3 = FALSE
        w4 = FALSE
      }
    }
    Property Node(instance in=reference to "Tv,ut (C)", "Disabled"=w4)
    Property Node(instance in=reference to "Tv,inn (C)", "Disabled"=w3)
    Property Node(instance in=reference to "Tk,inn (C)", "Disabled"=w2)
    Property Node(instance in=reference to "Tk,ut (C)", "Disabled"=w1)
    stop if FALSE
  }
  $"Velg hvilken temperatur som skal beregnes:" <- "Tk,ut"
  $"Cp,k (kJ/kgC)" <- 4.2
  $"Cp,v (kJ/kgC)" <- 4.2
  $"Tk,inn (C)" <- 20
  $"Tv,inn (C)" <- 90
  $"Tv,ut (C)" <- 60
  $"Fk (kg/s)" <- 20
  $"Fv (kg/s)" <- 20
